# Grasshopper definition P1.gh (Grasshopper 1.0.7)

number_slider = Slider(6, range=2..6)
rectangle = Rectangle({Plane=PlaneXY(19, 0, 0), Size=Domain2(u=-11..11, v=-1..1)})
polygon = Polygon(Plane=PlaneXY(0, 0, 0), Radius=30, Segments=6, FilletRadius=0)  # -> Polygon, Length
multiplication = Multiplication(A=number_slider, B=1.047197551)
polar_array = PolarArray(Geometry=rectangle, Plane=PlaneXY(0, 0, 0), Count=number_slider, Angle=multiplication)  # -> Geometry, Transform
region_difference = RegionDifference(CurvesA=polygon.Polygon, CurvesB=polar_array.Geometry)
vector_xyz = VectorXYZ(XComponent=0, YComponent=0, ZComponent=30)  # -> Vector, Length
extrude = Extrude(Base=region_difference, Direction=vector_xyz.Vector)
cap_holes = CapHoles(Brep=extrude)
