# Grasshopper definition P2.gh (Grasshopper 1.0.7)

circle = Circle({Plane=Plane(origin=(0, 0, 0), x=(0, 1, 0), y=(-1, 0, 0)), Radius=19})
vector_xyz = VectorXYZ(XComponent=0, YComponent=0, ZComponent=0)  # -> Vector, Length
linear_array = LinearArray(Geometry=circle, Direction=vector_xyz.Vector, Count=3)  # -> Geometry, Transform
series = Series(Start=1, Step=0.18, Count=3)
scale = Scale(Geometry=linear_array.Geometry, Center=Point(0, 0, 0), Factor=series)  # -> Geometry, Transform
offset_curve = OffsetCurve(Curve=scale.Geometry, Distance=2, Plane=PlaneXY(0, 0, 0), Corners=1)
merge = Merge(Data1=offset_curve, Data2=graft(scale.Geometry))
boundary_surfaces = BoundarySurfaces(Edges=offset_curve)
boundary_surfaces_2 = BoundarySurfaces(Edges=merge)
vector_xyz_2 = VectorXYZ(XComponent=0, YComponent=0, ZComponent=4)  # -> Vector, Length
vector_xyz_3 = VectorXYZ(XComponent=0, YComponent=0, ZComponent=26)  # -> Vector, Length
extrude = Extrude(Base=boundary_surfaces, Direction=vector_xyz_2.Vector)
extrude_2 = Extrude(Base=boundary_surfaces_2, Direction=vector_xyz_3.Vector)
merge_2 = Merge(Data1=extrude_2, Data2=extrude)
solid_union = SolidUnion(Breps=merge_2)
