# Grasshopper definition Shell1GH.gh (Grasshopper 1.0.7)

vector_xyz = VectorXYZ(XComponent=0, YComponent=Slider(-5, range=-5.001..-5), ZComponent=0)  # -> Vector, Length
rectangle = Rectangle({Plane=PlaneXY(-2, 170.7793275, 54), Size=Domain2(u=-98.25..98.25, v=-2.22067247..2.22067247)})
linear_array = LinearArray(Geometry=rectangle, Direction=vector_xyz.Vector, Count=Slider(86, range=-5..100))  # -> Geometry, Transform
