# Grasshopper definition OnePointZero.gh (Grasshopper 1.0.7)

polygon = Polygon(Plane=PlaneXY(0, 0, 0), Radius=22, Segments=6, FilletRadius=0)  # -> Polygon, Length
polygon_2 = Polygon(Plane=PlaneXY(0, 0, 0), Radius=80, Segments=6, FilletRadius=0)  # -> Polygon, Length
vector_xyz = VectorXYZ(XComponent=0, YComponent=0, ZComponent=-56)  # -> Vector, Length
polygon_3 = Polygon(Plane=PlaneXY(0, 0, 0), Radius=20, Segments=6, FilletRadius=0)  # -> Polygon, Length
polygon_4 = Polygon(Plane=PlaneXY(0, 0, 0), Radius=78, Segments=6, FilletRadius=0)  # -> Polygon, Length
vector_xyz_2 = VectorXYZ(XComponent=0, YComponent=0, ZComponent=4)  # -> Vector, Length
vector_xyz_3 = VectorXYZ(XComponent=0, YComponent=0, ZComponent=-4)  # -> Vector, Length
vector_xyz_4 = VectorXYZ(XComponent=0, YComponent=0, ZComponent=144)  # -> Vector, Length
move = Move(Geometry=polygon.Polygon, Motion=vector_xyz.Vector)  # -> Geometry, Transform
move_2 = Move(Geometry=polygon_4.Polygon, Motion=vector_xyz_3.Vector)  # -> Geometry, Transform
vector_xyz_5 = VectorXYZ(XComponent=0, YComponent=0, ZComponent=-52)  # -> Vector, Length
vector_xyz_6 = VectorXYZ(XComponent=0, YComponent=0, ZComponent=140)  # -> Vector, Length
move_3 = Move(Geometry=polygon.Polygon, Motion=vector_xyz_4.Vector)  # -> Geometry, Transform
move_4 = Move(Geometry=polygon_4.Polygon, Motion=vector_xyz_2.Vector)  # -> Geometry, Transform
move_5 = Move(Geometry=polygon_3.Polygon, Motion=vector_xyz_5.Vector)  # -> Geometry, Transform
move_6 = Move(Geometry=polygon_3.Polygon, Motion=vector_xyz_6.Vector)  # -> Geometry, Transform
offset_curve = OffsetCurve(Curve=move_2.Geometry, Distance=4, Plane=PlaneXY(0, 0, 0), Corners=2)
loft = Loft(
    Curves=[polygon_2.Polygon, move_3.Geometry],
    Options={Adjust=True, Closed=False, LoftEnds=0, LoftSimp=0, LoftType=0, Rebuild=10, Refit=0.01})
loft_2 = Loft(
    Curves=[move.Geometry, polygon_2.Polygon],
    Options={Adjust=False, Closed=False, LoftEnds=0, LoftSimp=0, LoftType=0, Rebuild=10, Refit=0.01})
boundary_surfaces = BoundarySurfaces(Edges=move_4.Geometry)
offset_curve_2 = OffsetCurve(Curve=move_6.Geometry, Distance=4, Plane=PlaneXY(0, 0, 0), Corners=2)
offset_curve_3 = OffsetCurve(Curve=move_5.Geometry, Distance=4, Plane=PlaneXY(0, 0, 0), Corners=2)
offset_curve_4 = OffsetCurve(Curve=polygon_2.Polygon, Distance=4, Plane=PlaneXY(0, 0, 0), Corners=2)
offset_curve_5 = OffsetCurve(Curve=move_3.Geometry, Distance=4, Plane=PlaneXY(0, 0, 0), Corners=2)
boundary_surfaces_2 = BoundarySurfaces(Edges=[offset_curve_2, move_6.Geometry])
offset_curve_6 = OffsetCurve(Curve=move.Geometry, Distance=4, Plane=PlaneXY(0, 0, 0), Corners=2)
boundary_surfaces_3 = BoundarySurfaces(Edges=[offset_curve_3, move_5.Geometry])
vector_xyz_7 = VectorXYZ(XComponent=0, YComponent=0, ZComponent=4)  # -> Vector, Length
vector_xyz_8 = VectorXYZ(XComponent=0, YComponent=0, ZComponent=-4)  # -> Vector, Length
extrude = Extrude(Base=boundary_surfaces, Direction=vector_xyz_7.Vector)
extrude_2 = Extrude(Base=boundary_surfaces_2, Direction=vector_xyz_7.Vector)
extrude_3 = Extrude(Base=boundary_surfaces_3, Direction=vector_xyz_8.Vector)
number_slider = Slider(4, range=3..10)
polygon_5 = Polygon(Plane=PlaneXY(0, 0, 0), Radius=20, Segments=4, FilletRadius=0)  # -> Polygon, Length
geometry = Geometry([<curve referenced from the Rhino model> x2])
polygon_6 = Polygon(Plane=PlaneXY(0, 0, 0), Radius=15, Segments=6, FilletRadius=0.5)  # -> Polygon, Length
polygon_7 = Polygon(Plane=PlaneXY(0, 0, 0), Radius=30, Segments=6, FilletRadius=0)  # -> Polygon, Length
vector_xyz_9 = VectorXYZ(XComponent=0, YComponent=0, ZComponent=10)  # -> Vector, Length
polar_array = PolarArray(Geometry=geometry, Plane=polygon_5.Polygon, Count=number_slider, Angle=6.283185307)  # -> Geometry, Transform
extrude_4 = Extrude(Base=polygon_6.Polygon, Direction=vector_xyz_9.Vector)
polar_array_2 = PolarArray(Geometry=polar_array.Geometry, Plane=polygon_7.Polygon, Count=number_slider, Angle=6.283185307)  # -> Geometry, Transform
cap_holes = CapHoles(Brep=extrude_4)
