# Grasshopper definition vav-1.gh (Grasshopper 1.0.7)

geometry = Geometry(<brep referenced from the Rhino model>)
scale = Scale(Geometry=geometry, Center=Point(0, 0, 0), Factor=44.02)  # -> Geometry, Transform
scale_2 = Scale(Geometry=geometry, Center=Point(0, 0, 0), Factor=26.63)  # -> Geometry, Transform
surface = Surface(<surface referenced from the Rhino model>)
number_slider = Slider(4, range=3..10)
polygon = Polygon(Plane=PlaneXY(0, 0, 0), Radius=20, Segments=4, FilletRadius=0)  # -> Polygon, Length
polygon_2 = Polygon(Plane=PlaneXY(0, 0, 0), Radius=100, Segments=6, FilletRadius=0)  # -> Polygon, Length
rotate = Rotate(Geometry=scale.Geometry, Angle=0.3717, Plane=PlaneYZ(0, 0, 0))  # -> Geometry, Transform
geometry_2 = Geometry([<brep referenced from the Rhino model> x4])
polygon_3 = Polygon(Plane=PlaneXY(0, 0, 0), Radius=56, Segments=6, FilletRadius=0)  # -> Polygon, Length
rotate_2 = Rotate(Geometry=scale_2.Geometry, Angle=0.5712, Plane=PlaneYZ(0, 0, 0))  # -> Geometry, Transform
line = Line(Line((-100, 0, 0), (-56, 0, -112)))
box = Box({Plane=Plane(origin=(-16, -9, 0), x=(0, 1, 0), y=(1, 0, 0)), X=Domain(0, 17), Y=Domain(0, 32), Z=Domain(-17, 0)})
line_2 = Line(Line((-56, 0, 208), (-100, 0, 0)))
divide_domain² = DivideDomain²(Domain=surface, UCount=2, VCount=2)
polygon_4 = Polygon(Plane=PlaneXY(0, 0, 0), Radius=28, Segments=6, FilletRadius=0)  # -> Polygon, Length
polygon_5 = Polygon(Plane=PlaneXY(0, 0, 0), Radius=100, Segments=6, FilletRadius=0)  # -> Polygon, Length
move = Move(Geometry=rotate_2.Geometry, Motion=Vector(0, 56, 0))  # -> Geometry, Transform
move_2 = Move(Geometry=polygon_3.Polygon, Motion=Vector(0, 0, -112))  # -> Geometry, Transform
polygon_6 = Polygon(Plane=PlaneXY(0, 0, 0), Radius=30, Segments=6, FilletRadius=0)  # -> Polygon, Length
polar_array = PolarArray(Geometry=line, Plane=PlaneXY(0, 0, 0), Count=6, Angle=6.283185307)  # -> Geometry, Transform
move_3 = Move(Geometry=polygon_3.Polygon, Motion=Vector(0, 0, 208))  # -> Geometry, Transform
polar_array_2 = PolarArray(Geometry=geometry_2, Plane=polygon.Polygon, Count=number_slider, Angle=6.283185307)  # -> Geometry, Transform
polar_array_3 = PolarArray(Geometry=line_2, Plane=PlaneXY(0, 0, 0), Count=6, Angle=6.283185307)  # -> Geometry, Transform
move_4 = Move(Geometry=rotate.Geometry, Motion=Vector(1, 87, 0))  # -> Geometry, Transform
vector_xyz = VectorXYZ(XComponent=0, YComponent=0, ZComponent=-28)  # -> Vector, Length
vector_xyz_2 = VectorXYZ(XComponent=0, YComponent=0, ZComponent=72)  # -> Vector, Length
surface_box = SurfaceBox(Surface=surface, Domain=divide_domain², Height=1)
polar_array_4 = PolarArray(Geometry=polar_array_2.Geometry, Plane=polygon_6.Polygon, Count=number_slider, Angle=6.283185307)  # -> Geometry, Transform
move_5 = Move(Geometry=polygon_4.Polygon, Motion=vector_xyz_2.Vector)  # -> Geometry, Transform
polar_array_5 = PolarArray(Geometry=move.Geometry, Plane=PlaneXY(0, 0, 0), Count=6, Angle=6.283185307)  # -> Geometry, Transform
move_6 = Move(Geometry=polygon_4.Polygon, Motion=vector_xyz.Vector)  # -> Geometry, Transform
polar_array_6 = PolarArray(Geometry=move_4.Geometry, Plane=PlaneXY(0, 0, 0), Count=6, Angle=6.283185307)  # -> Geometry, Transform
panel = Panel(polar_array_2.Geometry)
sweep2 = Sweep2(Rail1=move_3.Geometry, Rail2=move_2.Geometry, Sections=polar_array_3.Geometry, SameHeight=False)
sweep2_2 = Sweep2(Rail1=polygon_2.Polygon, Rail2=move_2.Geometry, Sections=polar_array.Geometry, SameHeight=False)
box_morph = BoxMorph(Geometry=geometry_2, Reference=box, Target=surface_box)
sweep2_3 = Sweep2(Rail1=polygon_2.Polygon, Rail2=move_2.Geometry, Sections=polar_array.Geometry, SameHeight=False)
vector_xyz_3 = VectorXYZ(XComponent=0, YComponent=0, ZComponent=-112)  # -> Vector, Length
surface_2 = Surface(<surface referenced from the Rhino model>)
geometry_3 = Geometry(<brep referenced from the Rhino model>)
surface_3 = Surface([sweep2, sweep2_2])
brep = Brep(<brep referenced from the Rhino model>)
move_7 = Move(Geometry=polar_array_5.Geometry, Motion=vector_xyz_3.Vector)  # -> Geometry, Transform
solid_difference = SolidDifference(BrepsA=geometry_3)
solid_difference_2 = SolidDifference(BrepsA=surface_2, BrepsB=geometry_3)
