# Grasshopper definition new.gh (Grasshopper 1.0.7)

geometry = Geometry([<curve referenced from the Rhino model> x4])
scale = Scale(Geometry=geometry, Center=Point(0, 0, 0), Factor=133.15)  # -> Geometry, Transform
scale_2 = Scale(Geometry=geometry, Center=Point(0, 0, 0), Factor=223.24)  # -> Geometry, Transform
rotate = Rotate(Geometry=scale_2.Geometry, Angle=0.3717, Plane=Plane(origin=(0, 0, 0), x=(0, 0, 1), y=(1, 0, 0)))  # -> Geometry, Transform
polygon = Polygon(Plane=PlaneXY(0, 0, 0), Radius=100, Segments=6, FilletRadius=0)  # -> Polygon, Length
polygon_2 = Polygon(Plane=PlaneXY(0, 0, 0), Radius=56, Segments=8, FilletRadius=0)  # -> Polygon, Length
rotate_2 = Rotate(Geometry=scale.Geometry, Angle=0.5712, Plane=Plane(origin=(0, 0, 0), x=(0, 0, 1), y=(1, 0, 0)))  # -> Geometry, Transform
circle = Circle({Plane=Plane(origin=(0, 0, 0), x=(0, -1, 0), y=(1, 0, 0)), Radius=18.89898842})
move = Move(Geometry=rotate.Geometry, Motion=Vector(-99, 0, 0))  # -> Geometry, Transform
move_2 = Move(Geometry=rotate_2.Geometry, Motion=Vector(-56, 0, 0))  # -> Geometry, Transform
rotate_3 = Rotate(Geometry=move.Geometry, Angle=1.047197551, Plane=PlaneXY(0, 0, 0))  # -> Geometry, Transform
rotate_4 = Rotate(Geometry=move_2.Geometry, Angle=0.7853981634, Plane=PlaneXY(0, 0, 0))  # -> Geometry, Transform
polar_array = PolarArray(Geometry=rotate_3.Geometry, Plane=PlaneXY(0, 0, 0), Count=6, Angle=6.283185307)  # -> Geometry, Transform
polar_array_2 = PolarArray(Geometry=rotate_4.Geometry, Plane=PlaneXY(0, 0, 0), Count=8, Angle=6.283185307)  # -> Geometry, Transform
vector_xyz = VectorXYZ(XComponent=0, YComponent=0, ZComponent=-112)  # -> Vector, Length
move_3 = Move(Geometry=polar_array_2.Geometry, Motion=vector_xyz.Vector)  # -> Geometry, Transform
